# Grasshopper definition Assignment_v01.gh (Grasshopper 1.0.7)

Y = UnitY(Factor=1)
pt = Point([Point(-39.700298, -0.4441409828, 0), Point(61.81765598, 42.03559652, 0), Point(158.8883066, 14.74751619, 0), Point(227.7861515, 47.92419386, 0), Point(339.0958976, 46.75980122, 0)])
pt_2 = Point([Point(-44.4506484, 131.5060364, 0), Point(98.81618235, 159.088611, 0), Point(215.027404, 121.6032289, 0), Point(306.7060576, 138.7958253, 0)])
X = UnitX(Factor=Slider(10, range=0..10))
line = LineSDL(Start=Point(0, 0, 0), Direction=Y, Length=Slider(177, range=0..2500))
pline = PolyLine(Vertices=pt, Closed=False)
pline_2 = PolyLine(Vertices=pt_2, Closed=False)
arrlinear = LinearArray(Geometry=line, Direction=X, Count=Slider(30, range=0..100))  # -> Geometry, Transform
end = EndPoints(Curve=arrlinear.Geometry)  # -> Start, End
ccx = CurveCurve(CurveA=pline, CurveB=arrlinear.Geometry)  # -> Points, ParamsA, ParamsB
ccx_2 = CurveCurve(CurveA=pline_2, CurveB=arrlinear.Geometry)  # -> Points, ParamsA, ParamsB
pt_3 = Point(ccx.Points)
pt_4 = Point(ccx_2.Points)
Z = UnitZ(Factor=Slider(68, range=0..100))
Z_2 = UnitZ(Factor=Slider(91, range=0..100))
move = Move(Geometry=pt_4, Motion=Z)  # -> simplify(Geometry), Transform
pt_5 = Point(simplify(graft(end.End)))
move_2 = Move(Geometry=pt_3, Motion=Z_2)  # -> simplify(Geometry), Transform
pt_6 = Point(simplify(graft(end.Start)))
pt_7 = Point([pt_5, move.Geometry, move_2.Geometry, pt_6])
yz = YZPlane(Origin=Point(0, 0, 0))
pline_3 = PolyLine(Vertices=pt_7, Closed=False)  # -> simplify(Polyline)
X_2 = UnitX(Factor=Slider(10, range=0..10))
offset = OffsetCurve(Curve=pline_3, Distance=Slider(4.946, range=0..10), Plane=yz, Corners=1)  # -> simplify(Curve)
loft = Loft(
    Curves=[pline_3, offset],
    Options={Adjust=False, Closed=False, LoftEnds=0, LoftSimp=0, LoftType=0, Rebuild=10, Refit=0.01})
extr = Extrude(Base=loft, Direction=X_2)

geo = Geometry(extr)
bbox = BoundingBox(Content=extr, Plane=PlaneXY(0, 0, 0))  # -> Box, Box_2
