# Grasshopper definition Residence_v01.gh (Grasshopper 1.0.7)

brep = Brep(<brep referenced from the Rhino model>)
X = UnitX(Factor=Slider(2500, range=0..10000))
arrlinear = LinearArray(Geometry=brep, Direction=X, Count=Slider(3, range=0..10))  # -> Geometry, Transform
Z = UnitZ(Factor=Slider(2500, range=0..10000))
arrlinear_2 = LinearArray(Geometry=arrlinear.Geometry, Direction=Z, Count=Slider(3, range=0..10))  # -> Geometry, Transform

brep_2 = Brep(<brep referenced from the Rhino model>)
X_2 = UnitX(Factor=Slider(2500, range=0..10000))
arrlinear_3 = LinearArray(Geometry=brep_2, Direction=X_2, Count=Slider(5, range=0..10))  # -> Geometry, Transform
Z_2 = UnitZ(Factor=Slider(2500, range=0..10000))
arrlinear_4 = LinearArray(Geometry=arrlinear_3.Geometry, Direction=Z_2, Count=Slider(4, range=0..10))  # -> Geometry, Transform
